# Grasshopper definition 2_data.gh (Grasshopper 1.0.7)

number_slider = Slider(10, range=0..10)
# 2_data
# 
# how to manage data in Grasshopper
curve = Curve(<curve referenced from the Rhino model>)
divide_curve = DivideCurve(Curve=curve, Count=number_slider, Kinks=False)  # -> Points, Tangents, Parameters
merge = Merge(Data1=Slider(1, range=0..10), Data2=Slider(4, range=0..10))
merge_2 = Merge(Data1=Toggle(True), Data2=Toggle(False), Data3=Toggle(False), Data4=Toggle(False))
merge_3 = Merge(Data1=Toggle(True), Data2=Toggle(False))
cull_pattern = CullPattern(List=divide_curve.Points, CullPattern=merge_2)
cull_pattern_2 = CullPattern(List=divide_curve.Points, CullPattern=merge_3)
list_item = ListItem(List=divide_curve.Points, Index=merge, Wrap=True)
cull_index = CullIndex(List=divide_curve.Points, Indices=Slider(1, range=0..10), Wrap=True)
panel = Panel(list_item)
panel_2 = Panel(divide_curve.Points)
panel_3 = Panel(cull_index)
panel_4 = Panel(cull_pattern)
panel_5 = Panel(cull_pattern_2)
divide_curve_2 = DivideCurve(Curve=curve, Count=number_slider, Kinks=False)  # -> Points, Tangents, Parameters
