# Grasshopper definition parade_parametrizada.gh (Grasshopper 1.0.7)

panel = Panel("TIJOLO A VISTA 10x6x20 cm")

comprimento = Slider(20, range=0..100)
largura = Slider(10, range=0..10)
altura = Slider(6, range=0..10)
domain_box = DomainBox(Base=PlaneXY(0, 0, 0), X=comprimento, Y=largura, Z=altura)

# ----
# Parede de teste
# 5 x 3 metros
panel_2 = Panel("300")
# https://www.archdaily.com.br/br/797614/16-detalhes-construtivos-de-aparelhamento-de-tijolos
# Unidade usada no Rhino -> cm (units)
# https://www.youtube.com/watch?v=stYu0Kfe3Ps
construct_point = ConstructPoint(XCoordinate=0, YCoordinate=0, ZCoordinate=0)
construct_point_2 = ConstructPoint(XCoordinate=0, YCoordinate="500", ZCoordinate=0)
unit_z = UnitZ(Factor=panel_2)
line = Line(StartPoint=construct_point, EndPoint=construct_point_2)
extrude = Extrude(Base=line, Direction=unit_z)

comprimento_2 = Slider(20, range=0..100)
largura_2 = Slider(10, range=0..10)
altura_2 = Slider(6, range=0..10)
domain_box_2 = DomainBox(Base=PlaneXY(0, 0, 0), X=comprimento_2, Y=largura_2, Z=altura_2)

# ----
# Parede de teste
# 5 x 3 metros
panel_4 = Panel("300")
construct_point_3 = ConstructPoint(XCoordinate=0, YCoordinate=0, ZCoordinate=0)
construct_point_4 = ConstructPoint(XCoordinate=0, YCoordinate="500", ZCoordinate=0)
unit_z_2 = UnitZ(Factor=panel_4)
line_2 = Line(StartPoint=construct_point_3, EndPoint=construct_point_4)
extrude_2 = Extrude(Base=line_2, Direction=unit_z_2)

comprimento_3 = Slider(20, range=0..100)
largura_3 = Slider(10, range=0..10)
altura_3 = Slider(6, range=0..10)
domain_box_3 = DomainBox(Base=PlaneXY(0, 0, 0), X=comprimento_3, Y=largura_3, Z=altura_3)

# ----
# Parede de teste
# 5 x 3 metros
panel_6 = Panel("300")
construct_point_5 = ConstructPoint(XCoordinate=0, YCoordinate=0, ZCoordinate=0)
construct_point_6 = ConstructPoint(XCoordinate=0, YCoordinate="500", ZCoordinate=0)
unit_z_3 = UnitZ(Factor=panel_6)
line_3 = Line(StartPoint=construct_point_5, EndPoint=construct_point_6)
extrude_3 = Extrude(Base=line_3, Direction=unit_z_3)

comprimento_4 = Slider(20, range=0..100)
largura_4 = Slider(10, range=0..10)
altura_4 = Slider(6, range=0..10)
domain_box_4 = DomainBox(Base=PlaneXY(0, 0, 0), X=comprimento_4, Y=largura_4, Z=altura_4)

# ----
# Parede de teste
# 5 x 3 metros
panel_8 = Panel("300")
construct_point_7 = ConstructPoint(XCoordinate=0, YCoordinate=0, ZCoordinate=0)
construct_point_8 = ConstructPoint(XCoordinate=0, YCoordinate="500", ZCoordinate=0)
unit_z_4 = UnitZ(Factor=panel_8)
line_4 = Line(StartPoint=construct_point_7, EndPoint=construct_point_8)
extrude_4 = Extrude(Base=line_4, Direction=unit_z_4)

# ---- group: altura
integer = Integer(altura_4)

# ---- group: comprimento
integer_2 = Integer(comprimento_4)

# ----
subtraction = Subtraction(A=integer_2, B=integer)

# ---- group: tijolo em pé
xz_plane = XZPlane(Origin=Point(0, 0, 0))
rotate = Rotate(Geometry=domain_box_4, Angle=1.570796327, Plane=xz_plane)  # -> Geometry, Transform

# ----
box = Box(domain_box)

# ---- group: altura
integer_3 = Integer(altura)

# ----
# parede junta-prumo
unit_z_5 = UnitZ(Factor=1)
# parede amarrada
unit_z_6 = UnitZ(Factor=1)
box_2 = Box(domain_box_2)

# ---- group: altura
integer_4 = Integer(altura_2)

# ----
surface = Surface(extrude)
# parede cobogó
unit_z_7 = UnitZ(Factor=1)
box_3 = Box(domain_box_3)

# ---- group: altura
integer_5 = Integer(altura_3)

# ----
surface_2 = Surface(extrude_2)
# parede cobogó
unit_z_8 = UnitZ(Factor=1)
box_4 = Box(domain_box_4)
surface_3 = Surface(extrude_3)
# A distância desconsidera argamassa, então recebe a mesma altura do tijolo
contour = Contour(Shape=surface_2, Point=Point(0, 0, 0), Direction=unit_z_5, Distance=integer_4)  # -> flatten(Contours)

# ---- group: A parade dividida pelo tijolo
comprimento_parede = Panel("500")
comprimento_tijolo = Panel(comprimento_2)
division = Division(A=comprimento_parede, B=comprimento_tijolo)
panel_9 = Panel(division)

# ----
# A distância desconsidera argamassa, então recebe a mesma altura do tijolo
contour_2 = Contour(Shape=surface, Point=Point(0, 0, 0), Direction=unit_z_6, Distance=integer_3)  # -> flatten(Contours)

# ---- group: parede / tijolo * 2
comprimento_parede_2 = Panel("500")
comprimento_tijolo_2 = Panel(comprimento)
division_2 = Division(A=comprimento_parede_2, B=comprimento_tijolo_2)
multiplication = Multiplication(A=division_2, B="2")
panel_10 = Panel(multiplication)
panel_11 = Panel(division_2)

# ----
surface_4 = Surface(extrude_4)
# A distância desconsidera argamassa, então recebe a mesma altura do tijolo
contour_3 = Contour(Shape=surface_3, Point=Point(0, 0, 0), Direction=unit_z_7, Distance=integer_5)  # -> flatten(Contours)

# ---- group: parede / tijlo + (parede / tijolo * 35%)
comprimento_parede_3 = Panel("500")
comprimento_tijolo_3 = Panel(comprimento_3)
division_3 = Division(A=comprimento_parede_3, B=comprimento_tijolo_3)
multiplication_2 = Multiplication(A=division_3, B="1.35")
panel_12 = Panel(multiplication_2)
panel_13 = Panel(division_3)

# ----
division_4 = Division(A=altura_4, B="2")
# A distância desconsidera argamassa, então recebe a mesma altura do tijolo
contour_4 = Contour(Shape=surface_4, Point=Point(0, 0, 0), Direction=unit_z_8, Distance="13")  # -> flatten(Contours)

# ---- group: parede / tijlo
comprimento_parede_4 = Panel("500")
comprimento_tijolo_4 = Panel(comprimento_4)
division_5 = Division(A=comprimento_parede_4, B=comprimento_tijolo_4)
panel_14 = Panel(division_5)

# ----
deconstruct_brep = DeconstructBrep(Brep=box)  # -> Faces, Edges, Vertices
deconstruct_brep_2 = DeconstructBrep(Brep=box_2)  # -> Faces, Edges, Vertices
# Separa as linhas impares das pares.
# 
# Fiadas impares e fiadas pares
dispatch = Dispatch(List=contour, DispatchPattern=[True, False])  # -> ListA, ListB
# Separa as linhas impares das pares.
# 
# Fiadas impares e fiadas pares
dispatch_2 = Dispatch(List=contour_2, DispatchPattern=[True, False])  # -> ListA, ListB
negative = Negative(Value=division_4)
deconstruct_brep_3 = DeconstructBrep(Brep=box_3)  # -> Faces, Edges, Vertices
# Separa as linhas impares das pares.
# 
# Fiadas impares e fiadas pares
dispatch_3 = Dispatch(List=contour_3, DispatchPattern=[True, False])  # -> ListA, ListB
deconstruct_brep_4 = DeconstructBrep(Brep=box_4)  # -> Faces, Edges, Vertices
dispatch_4 = Dispatch(List=contour_4, DispatchPattern=[True, False])  # -> ListA, ListB
area = Area(Geometry=rotate.Geometry)  # -> Area, Centroid
# Separa as linhas impares das pares.
# 
# Fiadas impares e fiadas pares
unit_z_9 = UnitZ(Factor=negative)
list_item = ListItem(List=deconstruct_brep.Faces, Index=Slider(4, range=0..10), Wrap=True)
curve = Curve(dispatch.ListA)
curve_2 = Curve(dispatch.ListB)
list_item_2 = ListItem(List=deconstruct_brep_2.Faces, Index=Slider(4, range=0..10), Wrap=True)
curve_3 = Curve(dispatch_2.ListA)
curve_4 = Curve(dispatch_2.ListB)
curve_5 = Curve(dispatch_3.ListA)
curve_6 = Curve(dispatch_3.ListB)
list_item_3 = ListItem(List=deconstruct_brep_3.Faces, Index=Slider(4, range=0..10), Wrap=True)
move = Move(Geometry=area.Centroid, Motion=unit_z_9)  # -> Geometry, Transform
area_2 = Area(Geometry=list_item)  # -> Area, Centroid
multiplication_3 = Multiplication(A=division_5, B="2")
curve_7 = Curve(dispatch_4.ListA)
curve_8 = Curve(dispatch_4.ListB)
list_item_4 = ListItem(List=deconstruct_brep_4.Faces, Index=Slider(4, range=0..10), Wrap=True)
# Aqui os tijolos estariam alinhados (junta prumo)
horizontal_frames = HorizontalFrames(Curve=curve, Count=division)  # -> Frames, Parameters
horizontal_frames_2 = HorizontalFrames(Curve=curve_2, Count=division)  # -> Frames, Parameters
# Aqui os tijolos estariam alinhados (junta prumo)
horizontal_frames_3 = HorizontalFrames(Curve=curve_3, Count=multiplication)  # -> Frames, Parameters
area_3 = Area(Geometry=list_item_2)  # -> Area, Centroid
horizontal_frames_4 = HorizontalFrames(Curve=curve_4, Count=multiplication)  # -> Frames, Parameters
# Aqui os tijolos estariam alinhados (junta prumo)
horizontal_frames_5 = HorizontalFrames(Curve=curve_5, Count=multiplication_2)  # -> Frames, Parameters
horizontal_frames_6 = HorizontalFrames(Curve=curve_6, Count=multiplication_2)  # -> Frames, Parameters
area_4 = Area(Geometry=list_item_3)  # -> Area, Centroid
panel_15 = Panel(area.Centroid)
panel_16 = Panel(move.Geometry)
# Aqui os tijolos estariam alinhados (junta prumo)
horizontal_frames_7 = HorizontalFrames(Curve=curve_7, Count=multiplication_3)  # -> Frames, Parameters
horizontal_frames_8 = HorizontalFrames(Curve=curve_8, Count=multiplication_3)  # -> Frames, Parameters
area_5 = Area(Geometry=list_item_4)  # -> Area, Centroid
point = Point(area_2.Centroid)
point_2 = Point(area_3.Centroid)
dispatch_5 = Dispatch(List=horizontal_frames.Frames, DispatchPattern=[True, False])  # -> ListA, ListB
dispatch_6 = Dispatch(List=horizontal_frames_2.Frames, DispatchPattern=[True, False])  # -> ListA, ListB
dispatch_7 = Dispatch(List=horizontal_frames_3.Frames, DispatchPattern=[True, False])  # -> ListA, ListB
dispatch_8 = Dispatch(List=horizontal_frames_4.Frames, DispatchPattern=[True, False])  # -> ListA, ListB
point_3 = Point(area_4.Centroid)
dispatch_9 = Dispatch(List=horizontal_frames_5.Frames, DispatchPattern=[True, False])  # -> ListA, ListB
dispatch_10 = Dispatch(List=horizontal_frames_6.Frames, DispatchPattern=[True, False])  # -> ListA, ListB
point_4 = Point(area_5.Centroid)
point_5 = Point(move.Geometry)

# ---- group: sem uso
dispatch_11 = Dispatch(List=horizontal_frames_8.Frames, DispatchPattern=[True, False])  # -> ListA, ListB
dispatch_12 = Dispatch(List=horizontal_frames_7.Frames, DispatchPattern=[True, False])  # -> ListA, ListB

# ----
plane = Plane(horizontal_frames_2.Frames)
# Aqui os tijolos ficam alternados (amarrados)
plane_2 = Plane(horizontal_frames.Frames)
plane_3 = Plane(dispatch_8.ListB)
# Aqui os tijolos ficam alternados (amarrados)
plane_4 = Plane(dispatch_7.ListA)
plane_5 = Plane(dispatch_10.ListB)
# Aqui os tijolos ficam alternados (amarrados)
plane_6 = Plane(dispatch_9.ListA)
plane_7 = Plane(dispatch_11.ListB)
# Aqui os tijolos ficam alternados (amarrados)
plane_8 = Plane(dispatch_12.ListA)
orient = Orient(Geometry=box_2, Source=point_2, Target=plane_2)  # -> Geometry, Transform
orient_2 = Orient(Geometry=box_2, Source=point_2, Target=plane)  # -> Geometry, Transform
orient_3 = Orient(Geometry=box, Source=point, Target=plane_4)  # -> Geometry, Transform
orient_4 = Orient(Geometry=box, Source=point, Target=plane_3)  # -> Geometry, Transform
orient_5 = Orient(Geometry=box_3, Source=point_3, Target=plane_6)  # -> Geometry, Transform
orient_6 = Orient(Geometry=box_3, Source=point_3, Target=plane_5)  # -> Geometry, Transform
orient_7 = Orient(Geometry=box_4, Source=point_4, Target=plane_8)  # -> Geometry, Transform
orient_8 = Orient(Geometry=rotate.Geometry, Source=point_5, Target=plane_7)  # -> Geometry, Transform
