# Grasshopper definition space_truss_generator.gh (Grasshopper 0.9.76)
# plug-ins: Python Interpreter

pt = ConstructPoint(XCoordinate=0, YCoordinate=0, ZCoordinate=0)
pt_2 = ConstructPoint(XCoordinate=0, YCoordinate=10, ZCoordinate=0)
pt_3 = ConstructPoint(XCoordinate=10, YCoordinate=10, ZCoordinate=0)
pt_4 = ConstructPoint(XCoordinate=10, YCoordinate=0, ZCoordinate=0)
srf4pt = _4PointSurface(CornerA=pt, CornerB=pt_2, CornerC=pt_3, CornerD=pt_4)
sdivide = DivideSurface(UCount=10, VCount=10)  # -> Points, Normals, Parameters
python = PythonScript(x=srf4pt)  # -> out, a; inputs x: Surface
# ---------- python: Python ----------
a = x
# ---------- end python ----------
